# Grasshopper definition TEST - grid auto param.gh (Grasshopper 0.9.76)
# plug-ins: IvyGh

d0 = Slider(-1.15, range=-2..2)
d1 = Slider(5, range=-7..5)
num = Number(Tree({1}: [-2, 1, 2], {2}: [-7, 5, 3, 1]))
slider = GridSlider(range=num, D0=d0, D1=d1)  # -> Info, Point, Cell
panel = Panel(num)
panel_2 = Panel([slider.Point, slider.Cell])
panel_3 = Panel(slider.Info)
